# Grasshopper definition Feb2023_987 MorseCodeRing Template.ghx (Grasshopper 1.0.7)

ratio_short_long_1_x = ValueList({"1", "2", "2.5", "3", "3.5", "4", "4.5", "5"}, selected="3")
ring_s_overall_height = Slider(12, range=0.05..50)

# ---- group: TEXT INPUTS
# 987 MorseCodeRing © 2022 by 987 destiny engineering & Lo I Ting is licensed under Attribution-NonCommercial 4.0 International. To view a copy of this license, visit http://creativecommons.org/licenses/by-nc/4.0/
# 
# -----------------------------------------------------------
# if you need further information please read README!
# feel free to customise this template to fulfill your needs!
# if you would like to improve this script, please kindly update on github too, thank you.
# 
# and have fun :)
panel = Panel("L0o0v0e0")
panel_2 = Panel("J0u0s0t01010")
panel_3 = Panel("010L0i0k0e0101010101010")
panel_4 = Panel("W0a0t0e0r010101010")

# ----
ring_s_inner_diameter_in_mm = Slider(20, range=0..50)
ring_s_thickness = Slider(2, range=0..20)
ring_s_wire_width = Slider(0.5, range=0.1..3)

# ---- group: About Styles
list = ValueList({"Rectangular Style": 0, "Pipe Style": 1}, selected="Pipe Style")

# ---- group: FINAL: output in Rhino
are_you_ready_to_bake_your_ring = Button()
panel_5 = Panel("Layer Name:Your Data Record Information")
swatch = ColourSwatch(SwatchColor=RGB(212, 190, 66))

# ----
code_encoder = CSharpScript(
    vocab1=panel,
    vocab2=panel_2,
    Diameter=ring_s_inner_diameter_in_mm,
    TotalHeight=ring_s_overall_height,
    LineWidth=ring_s_wire_width,
    Ratio=ratio_short_long_1_x,
    Style=list)  # -> out, C, U, F, HU; inputs vocab1: String, vocab2: String, vocab3: String, vocab4: String, Diameter: Double, TotalHeight: Double, LineWidth: Double, Ratio: Double, Style: Int32
# ---------- code_encoder: C# usings ----------
using System.Text;
using System.Linq;
# ---------- code_encoder: C# ----------
    //Variables
    //For height calculation in next step
    List<string> CountV = new List<string>();

    double TotalLength = Diameter * Math.PI;
    List<double> UnitCount = new List<double>();


    //Here's the Moscode Encoding!------------------------------------------------------------------------------------------
    if(vocab1 == null) this.Component.AddRuntimeMessage(GH_RuntimeMessageLevel.Warning, "Please add at least one input");
    else{
      string M1 = MoscodeEncoder(VocabCheck(vocab1));
      Print(M1);
      CountV.Add(M1);
      if(vocab2 != null){
        string M2 = MoscodeEncoder(VocabCheck(vocab2));
        CountV.Add(M2);
        if(vocab3 != null){
          string M3 = MoscodeEncoder(VocabCheck(vocab3));
          CountV.Add(M3);
          if(vocab4 != null){
            string M4 = MoscodeEncoder(VocabCheck(vocab4));
            CountV.Add(M4);
          }
        }
      }
    }




    //Here's for height unit and short unit calculations!--------------------------------------------------------------------
    //To decide short unit standard
    //First adding four moscode into a list
    //Calculate four moscode's char total units
    for(int i = 0; i < CountV.Count;i++)
    {
      string c = CountV[i];

      int Scount = c.Count(f => f == 'S');
      int Ecount = c.Count(f => f == 'E');
      int Lcount = c.Count(f => f == 'L');
      int lineAmount = c.Count(f => f == 'I');
      double charUnit = Scount + Ecount + (Lcount * Ratio);
      UnitCount.Add(charUnit);
    }

    //Comparison
    double final;
    final = UnitCount[0];
    string finalV = CountV[0];
    for(int i = 1;i < CountV.Count;i++)
    {
      if(UnitCount[i] >= final)
      {
        final = UnitCount[i];
        finalV = CountV[i];
      }
    }

    int lineCalculate = finalV.Count(f => f == 'I');
    double units = TotalLength / final;
    units = Math.Round(units, 2, MidpointRounding.AwayFromZero);

    //Display Preivew
    //Decide what's the height(Pt2's Y)???
    double heightunit = 0;
    if(Style == 0) heightunit = (TotalHeight - LineWidth) / CountV.Count;
    else if(Style == 1) heightunit = (TotalHeight + LineWidth * (CountV.Count - 1)) / CountV.Count;

    //Outputs-------------------------------------------------------------------------------------------
    U = units;
    F = final;
    C = CountV;
    HU = heightunit;
# ---------- code_encoder: C# additional code ----------
  //CHECK EVERYTHING
  public static string VocabCheck(string testvocab)
  {
    //UpperCaseCHECK
    string vocab1UPPER = testvocab.ToUpper();

    //Space check
    string vocabSPACE = string.Join("", vocab1UPPER.Split(default(string[]), StringSplitOptions.RemoveEmptyEntries));

    //Invalid Character Check
    StringBuilder vocabSpecialC = new StringBuilder();
    foreach(char c in vocabSPACE)
    {
      if((c >= 'A' && c <= 'Z' ) || c == '0' || c == '1')
      {
        vocabSpecialC.Append(c);
      }
    }
    return vocabSpecialC.ToString();
  }

  //Moscode chart
  public static string Moscode(char v)
  {
    string MTransfer = "";

    switch(v)
    {
      case 'A':
        MTransfer = "SEL";
        break;
      case 'B':
        MTransfer = "LESESES";
        break;
      case 'C':
        MTransfer = "LESELES";
        break;
      case 'D':
        MTransfer = "LESES";
        break;
      case 'E':
        MTransfer = "S";
        break;
      case 'F':
        MTransfer = "SESELES";
        break;
      case 'G':
        MTransfer = "LELES";
        break;
      case 'H':
        MTransfer = "SESESES";
        break;
      case 'I':
        MTransfer = "SES";
        break;
      case 'J':
        MTransfer = "SELELEL";
        break;
      case 'K':
        MTransfer = "LESEL";
        break;
      case 'L':
        MTransfer = "SELESES";
        break;
      case 'M':
        MTransfer = "LEL";
        break;
      case 'N':
        MTransfer = "LES";
        break;
      case 'O':
        MTransfer = "LELEL";
        break;
      case 'P':
        MTransfer = "SELELES";
        break;
      case 'Q':
        MTransfer = "LELESEL";
        break;
      case 'R':
        MTransfer = "SELES";
        break;
      case 'S':
        MTransfer = "SESES";
        break;
      case 'T':
        MTransfer = "L";
        break;
      case 'U':
        MTransfer = "SESEL";
        break;
      case 'V':
        MTransfer = "SESESEL";
        break;
      case 'W':
        MTransfer = "SELEL";
        break;
      case 'X':
        MTransfer = "LESESEL";
        break;
      case 'Y':
        MTransfer = "LESELEL";
        break;
      case 'Z':
        MTransfer = "LELESES";
        break;
      default:
        // code block
        break;
    }

    return MTransfer;
  }

  //Moscode Transformation Loop
  public static string MoscodeEncoder(string Inputvocab)
  {
    String MTras = "";
    for(int i = 0; i < Inputvocab.Length;i++)
    {
      char tmp = Inputvocab[i];

      if(tmp == '0' || tmp == '1')
      {
        if(tmp == '0') MTras += "E";
        else if(tmp == '1') MTras += "I";
      }
      MTras += Moscode(tmp);//call function below
    }

    return MTras;
  }
# ---------- end code_encoder ----------
# Caution: Pipe is way
# SLOWER
# than Rectangle
ring3d_geometry = CSharpScript(
    CountV=code_encoder.C,
    height=code_encoder.HU,
    units=code_encoder.U,
    LargestCount=code_encoder.F,
    Diameter=ring_s_inner_diameter_in_mm,
    LineWidth=ring_s_wire_width,
    Ratio=ratio_short_long_1_x,
    RingThickness=ring_s_thickness,
    OverallHeight=ring_s_overall_height,
    Style=list)  # -> out, AllBrep, Unit, Empty, LineSeperator; inputs CountV: list of String, height: Double, units: Double, LargestCount: Double, Diameter: Double, LineWidth: Double, Ratio: Double, RingThickness: Double, OverallHeight: Double, Style: Int32
# ---------- ring3d_geometry: C# usings ----------
using System.Linq;
# ---------- ring3d_geometry: C# ----------
    //Variable
    double Tolerance = doc.ModelAbsoluteTolerance;
    double AngleTolerance = doc.ModelAngleToleranceRadians;
    List <Brep> Ring = new List<Brep>();
    List<Brep> OverALLBreps = new List<Brep>();
    List<Brep> ShortExtrusion = new List<Brep>();
    List<Brep> LongExtrusion = new List<Brep>();
    List<Brep> SeperatorExtrusion = new List<Brep>();
    List<Curve> LineCrv = new List<Curve>();
    List<Brep> RingWire = new List<Brep>();

    //Calculate Inner Diameter of the Ring
    Circle RingInnerCrv = new Circle(new Point3d(-Diameter, 0, 0), Diameter / 2.0);
    NurbsCurve CNurbs = RingInnerCrv.ToNurbsCurve();
    Curve RingCurve = CNurbs.DuplicateCurve();
    if(Style == 0)
    {
      Transform RecLayerHeightVecor = Transform.Translation(new Vector3d(0, 0, -LineWidth / 2));
      RingCurve.Transform(RecLayerHeightVecor);
    }
    else if(Style == 1)
    {
      Transform RecLayerHeightVecor = Transform.Translation(new Vector3d(0, 0, LineWidth / 2));
      RingCurve.Transform(RecLayerHeightVecor);
    }

    double TotalLength = LargestCount * units;


    //Generate Geomery-----------------------------------------------------------------------
    for(int a = 0; a < CountV.Count; a++)
    {

      int count = Math.Abs(a - (CountV.Count - 1)); //reverse generate order
      string Inputvocab = CountV[count];// vocab-> top layer
      int CurrentLayer = a;

      //calculate it's paremeter and split //S L E 1
      double CrvDomain = CNurbs.Domain.T1 - CNurbs.Domain.T0;
      double Params = CNurbs.Domain.T0;

      //caution : If you change the 2D pattern preview, this rule will need to update too!
      List <double> ParamsList = new List<double>{Params}; //remember to add the initial value
      for(int i = 0; i < Inputvocab.Length; i++)
      {
        if(Inputvocab[i] == 'S') Params += units;
        else if(Inputvocab[i] == 'L') Params += (Ratio * units);
        else if(Inputvocab[i] == 'E') Params += units;
        else if(Inputvocab[i] == 'I'){

          //correct the previous param
          Params -= LineWidth / 2;
          double Domainprevious = (Params / TotalLength) * CrvDomain;
          ParamsList[i] = Domainprevious; //Replace the previous param

          Params += LineWidth;
          double Domainline = (Params / TotalLength) * CrvDomain;
          ParamsList.Add(Domainline); //Add in Linewidth seperator
          Params -= (LineWidth / 2); // Back to the normal unit position
          continue; //Skip the normal routine
        }
        else break;

        double Domain = (Params / TotalLength) * CrvDomain;
        ParamsList.Add(Domain);
      }

      Curve[] SplitCrv = CNurbs.Split(ParamsList);


      //STEP 2----------------------------------------------------------------------------------------------
      //Brep List Collections
      //List <int> EdgeIndex = new List<int>(){2,6,8,10};
      List <int> EdgeIndex = new List<int>(){0,1,2,3,4,5,6,7,8,9,10,11};
      double FR = (LineWidth / 2 + 0.05); //To be able to Boolean
      double[] FilletRadius = new double[]{FR,FR,FR,FR,FR,FR,FR,FR,FR,FR,FR,FR};

      //For Blocks (Short Long Lines"1")
      for(int i = 0; i < Inputvocab.Length; i++)
      {
        if(Inputvocab[i] == 'S')
        {
          Brep Block = MakingBlock(SplitCrv[i], RingThickness, LineWidth, EdgeIndex, FilletRadius, Tolerance, height, Style);
          ShortExtrusion.Add(Block);
        }
        else if(Inputvocab[i] == 'L')
        {
          Brep Block = MakingBlock(SplitCrv[i], RingThickness, LineWidth, EdgeIndex, FilletRadius, Tolerance, height, Style);
          LongExtrusion.Add(Block);
        }
        else if(Inputvocab[i] == 'I') //Line
        {
          LineCrv.Add(SplitCrv[i]);
          Brep[] tmpBlock = MakingWire(SplitCrv[i], RingThickness, LineWidth, Tolerance, AngleTolerance, height, Style);
          SeperatorExtrusion.Add(tmpBlock[0]);
          SeperatorExtrusion.Add(tmpBlock[1]);
          SeperatorExtrusion.Add(tmpBlock[2]);
          SeperatorExtrusion.Add(tmpBlock[3]);
        }
        else if(Inputvocab[i] == 'E') continue;
      }


      //Construct Circle Ring Base & Bottom
      List <Brep> Ringtmp = MakingCircle(RingCurve, Diameter, RingThickness, LineWidth, Tolerance, AngleTolerance, LineWidth, Style);
      RingWire.Add(Ringtmp[0]);
      RingWire.Add(Ringtmp[1]);

      //Prepare for the next layer
      Transform LayerHeightVecor = new Transform();
      if(Style == 1)
      {
        LayerHeightVecor = Transform.Translation(new Vector3d(0, 0, height - LineWidth));
      }
      else
      {
        LayerHeightVecor = Transform.Translation(new Vector3d(0, 0, height));
      }

      CNurbs.Transform(LayerHeightVecor);
      RingCurve.Transform(LayerHeightVecor);

    }

    //The Most top layer-> Moving Up
    List<Brep> Ringtmp2 = MakingCircle(RingCurve, Diameter, RingThickness, LineWidth, Tolerance, AngleTolerance, LineWidth, Style);
    RingWire.Add(Ringtmp2[0]);
    RingWire.Add(Ringtmp2[1]);


    //Join Everything tgt
    for(int i = 0; i < ShortExtrusion.Count; i++)
    { OverALLBreps.Add(ShortExtrusion[i]); }
    for(int i = 0; i < LongExtrusion.Count; i++)
    { OverALLBreps.Add(LongExtrusion[i]); }
    for(int i = 0; i < SeperatorExtrusion.Count; i++)
    { OverALLBreps.Add(SeperatorExtrusion[i]);}
    for(int i = 0; i < RingWire.Count; i++)
    { OverALLBreps.Add(RingWire[i]);}



    AllBrep = OverALLBreps;
    Unit = units;
# ---------- ring3d_geometry: C# additional code ----------
  //How to make a Short & Long Unit Block
  //rectangle - normal block
  //pipe - fillet blocks above
  public static Brep MakingBlock(Curve SplitCrv, double RingThickness, double LineWidth, List<int>EdgeIndex, double[] FilletRadius, double Tolerance, double height, int Style)
  {
    Curve[] OffsetCrv = SplitCrv.Offset(Plane.WorldXY, RingThickness, Tolerance, CurveOffsetCornerStyle.None);
    Line Startcrv = new Line(SplitCrv.PointAtStart, OffsetCrv[0].PointAtStart);
    Line endcrv = new Line(SplitCrv.PointAtEnd, OffsetCrv[0].PointAtEnd);

    //prepare for join
    Curve[] tmp = new Curve[4];
    tmp[0] = SplitCrv;
    tmp[1] = Startcrv.ToNurbsCurve();
    tmp[2] = OffsetCrv[0];
    tmp[3] = endcrv.ToNurbsCurve();
    Curve[] BaseBlock = Curve.JoinCurves(tmp);

    //Extrusion & become Solid for Short & Long
    Brep Block = MakingBrepBlock(BaseBlock[0], height, Tolerance);

    //if style is pipe
    if(Style == 1)
    {
      Brep[] Blocktmp = Brep.CreateFilletEdges(Block, EdgeIndex, FilletRadius, FilletRadius, BlendType.Fillet, RailType.RollingBall, Tolerance);
      Block = Blocktmp[0];
    }

    return Block;
  }

  //How to make a Line Wire Seperator & bridge
  public static Brep[] MakingWire(Curve SplitCrv, double RingThickness, double LineWidth, double Tolerance, double AngleTolerance, double height, int Style)
  {
    Brep[] Final = new Brep[4];
    Curve[] OuterCrv = SplitCrv.Offset(Plane.WorldXY, RingThickness, Tolerance, CurveOffsetCornerStyle.None);
    Curve[] InnerOffset = SplitCrv.Offset(Plane.WorldXY, LineWidth, Tolerance, CurveOffsetCornerStyle.None);
    Curve[] OuterOffsetCrv = OuterCrv[0].Offset(Plane.WorldXY, (LineWidth * -1), Tolerance, CurveOffsetCornerStyle.None);


    if(Style == 0){
      //Constructing Vertical blocks-------------------------------------------------------------------------------
      Line Startcrv1 = new Line(SplitCrv.PointAtStart, InnerOffset[0].PointAtStart);
      Line endcrv1 = new Line(SplitCrv.PointAtEnd, InnerOffset[0].PointAtEnd);

      Line Startcrv2 = new Line(OuterCrv[0].PointAtStart, OuterOffsetCrv[0].PointAtStart);
      Line endcrv2 = new Line(OuterCrv[0].PointAtEnd, OuterOffsetCrv[0].PointAtEnd);

      Curve[] tmp = new Curve[4];
      tmp[0] = SplitCrv;
      tmp[1] = Startcrv1.ToNurbsCurve();
      tmp[2] = InnerOffset[0];
      tmp[3] = endcrv1.ToNurbsCurve();
      Curve[] BaseBlock = Curve.JoinCurves(tmp);

      //Extrusion & become Solid for Line1
      Brep Block = MakingBrepBlock(BaseBlock[0], height, Tolerance);

      Curve[] tmp2 = new Curve[4];
      tmp2[0] = OuterCrv[0];
      tmp2[1] = Startcrv2.ToNurbsCurve();
      tmp2[2] = OuterOffsetCrv[0];
      tmp2[3] = endcrv2.ToNurbsCurve();
      Curve[] BaseBlock2 = Curve.JoinCurves(tmp2);

      //Extrusion & become Solid for Line2
      Brep Block2 = MakingBrepBlock(BaseBlock2[0], height, Tolerance);
      Final[0] = Block;
      Final[1] = Block2;

      //Constructing Horizontal Bridge blocks-------------------------------------------------------------------------------
      //Extrusions for bridging
      Line Startcrv = new Line(OuterCrv[0].PointAtStart, SplitCrv.PointAtStart);
      Line endcrv = new Line(OuterCrv[0].PointAtEnd, SplitCrv.PointAtEnd);

      Curve[] bridgeCrv = new Curve[4];
      bridgeCrv[0] = SplitCrv;
      bridgeCrv[1] = Startcrv.ToNurbsCurve();
      bridgeCrv[2] = OuterCrv[0];
      bridgeCrv[3] = endcrv.ToNurbsCurve();
      Curve[] BaseBlock3 = Curve.JoinCurves(bridgeCrv);

      Brep Bridge = MakingBrepBlock(BaseBlock3[0], LineWidth, Tolerance);
      Final[2] = Bridge;

      //BridgeAbove
      Transform movingUp = Transform.Translation(new Vector3d(0, 0, height - LineWidth));
      BaseBlock3[0].Transform(movingUp);
      Brep Bridge2 = MakingBrepBlock(BaseBlock3[0], LineWidth, Tolerance);
      Final[3] = Bridge2;


    }else if(Style == 1){
      //Inner
      Transform movingUp = Transform.Translation(new Vector3d(0, 0, height));

      Curve InnerUP = SplitCrv.DuplicateCurve();
      InnerUP.Transform(movingUp);
      Curve OuterUP = InnerOffset[0].DuplicateCurve();
      OuterUP.Transform(movingUp);

      Brep Block = MakingNormalPipe(SplitCrv, InnerOffset[0], InnerUP, OuterUP, LineWidth, Tolerance, AngleTolerance);
      Final[0] = Block;

      //Outer
      InnerUP = OuterOffsetCrv[0].DuplicateCurve();
      InnerUP.Transform(movingUp);
      OuterUP = OuterCrv[0].DuplicateCurve();
      OuterUP.Transform(movingUp);

      Brep Block2 = MakingNormalPipe(OuterOffsetCrv[0], OuterCrv[0], InnerUP, OuterUP, LineWidth, Tolerance, AngleTolerance);
      Final[1] = Block2;

      //BridgeBelow
      Transform brigeUP = Transform.Translation(new Vector3d(0, 0, LineWidth));

      InnerUP = SplitCrv.DuplicateCurve();
      InnerUP.Transform(brigeUP);
      OuterUP = OuterCrv[0].DuplicateCurve();
      OuterUP.Transform(brigeUP);

      Brep Bridge = MakingNormalPipe(SplitCrv, InnerUP, OuterCrv[0], OuterUP, LineWidth, Tolerance, AngleTolerance);
      Final[2] = Bridge;

      //BridgeAbove
      Transform movingUp2 = Transform.Translation(new Vector3d(0, 0, height - LineWidth));

      Curve SplitDup = SplitCrv.DuplicateCurve();
      SplitDup.Transform(movingUp2);
      InnerUP = SplitDup.DuplicateCurve();
      InnerUP.Transform(brigeUP);

      Curve OuterDup = OuterCrv[0].DuplicateCurve();
      OuterDup.Transform(movingUp2);
      OuterUP = OuterDup.DuplicateCurve();
      OuterUP.Transform(brigeUP);

      Brep Bridge2 = MakingNormalPipe(SplitDup, InnerUP, OuterDup, OuterUP, LineWidth, Tolerance, AngleTolerance);
      Final[3] = Bridge2;

    }

    return Final;
  }

  //How to make a Circle Wire Ring Blocks
  public static List<Brep> MakingCircle(Curve circleCrv, double Diameter, double RingThickness, double LineWidth, double Tolerance, double AngleTolerance, double height, int Style)
  {
    List<Brep> Blocks = new List<Brep>();

    if(Style == 0){
      Tolerance = Tolerance * 2; //for boolean union purpose!!
      Curve[] Crv = circleCrv.Offset(Plane.WorldXY, Tolerance, Tolerance, CurveOffsetCornerStyle.None);
      Curve CircleCrv = Crv[0];

      Curve[] OuterCrv = CircleCrv.Offset(Plane.WorldXY, RingThickness + (Tolerance * 2), Tolerance, CurveOffsetCornerStyle.None);
      Curve[] InnerOffset = CircleCrv.Offset(Plane.WorldXY, LineWidth + Tolerance, Tolerance, CurveOffsetCornerStyle.None);
      Curve[] OuterOffsetCrv = OuterCrv[0].Offset(Plane.WorldXY, ((LineWidth + Tolerance) * -1), Tolerance, CurveOffsetCornerStyle.None);
      Curve[] Innertmp = new Curve[2];
      Innertmp[0] = CircleCrv;
      Innertmp[1] = InnerOffset[0];

      Curve[] tmp2 = new Curve[2];
      tmp2[0] = OuterCrv[0];
      tmp2[1] = OuterOffsetCrv[0];

      //First Circle Solid
      //1 Inner
      Brep Block = MakingBrepRing(Innertmp, height, Tolerance, Style);
      Blocks.Add(Block);

      //2 Outer
      Block = MakingBrepRing(tmp2, height, Tolerance, Style);
      Blocks.Add(Block);

    }else if(Style == 1)
    {
      Curve CircleCrv = circleCrv;
      LineWidth += Tolerance;
      //Inner
      Curve[] InnerCrv = CircleCrv.Offset(Plane.WorldXY, LineWidth / 2.0, Tolerance, CurveOffsetCornerStyle.None);
      Brep[] Blocktmp = Brep.CreatePipe(InnerCrv[0], LineWidth / 2, false, PipeCapMode.None, true, Tolerance, AngleTolerance);
      Blocks.Add(Blocktmp[0]);

      //Outer
      Curve[] OuterCrv = CircleCrv.Offset(Plane.WorldXY, RingThickness - (LineWidth / 2.0), Tolerance, CurveOffsetCornerStyle.None);
      Blocktmp = Brep.CreatePipe(OuterCrv[0], LineWidth / 2, false, PipeCapMode.Round, true, Tolerance, AngleTolerance);
      Blocks.Add(Blocktmp[0]);
    }

    return Blocks;
  }

  //Functions: Construct Breps
  public static Brep MakingBrepBlock(Curve Basecrv, double height, double Tolerance)
  {
    //Extrusion & become Solid for Line1
    Transform movingUp = Transform.Translation(new Vector3d(0, 0, height));
    Curve BaseUP = Basecrv.DuplicateCurve();
    BaseUP.Transform(movingUp);

    List<Curve> SideLoft = new List<Curve> {Basecrv, BaseUP};
    Line crossRail = new Line(Basecrv.PointAtStart, BaseUP.PointAtStart);
    Curve crossRailCrv = crossRail.ToNurbsCurve();

    Brep[] Blockbrep = Brep.CreateFromSweep(Basecrv, BaseUP, crossRailCrv, false, Tolerance);
    Brep[] Bottomsrf = Brep.CreatePlanarBreps(Basecrv, Tolerance);
    Brep[] Topsrf = Brep.CreatePlanarBreps(BaseUP, Tolerance);

    Brep[] BrepList = new Brep[3];
    BrepList[0] = Bottomsrf[0];
    BrepList[1] = Topsrf[0];
    BrepList[2] = Blockbrep[0];

    Brep[] Block = Brep.JoinBreps(BrepList, Tolerance);
    return Block[0];
  }
  //Functions: Construct Breps
  public static Brep MakingBrepRing(Curve[] Innertmp, double height, double Tolerance, int Style)
  {
    //Moving Up Vector
    Transform movingUp = Transform.Translation(new Vector3d(0, 0, height));

    //Construct RingWire 4 surfaces
    Curve UP1 = Innertmp[0].DuplicateCurve();
    UP1.Transform(movingUp);
    Curve UP2 = Innertmp[1].DuplicateCurve();
    UP2.Transform(movingUp);
    Curve[] BaseUP = new Curve[]{UP1,UP2};

    Brep Block;

    //1
    Brep[] InnerBaseSrf = Brep.CreateFromLoft(Innertmp, Point3d.Unset, Point3d.Unset, LoftType.Normal, false);
    //2
    Brep[] InnerBaseSrfUP = Brep.CreateFromLoft(BaseUP, Point3d.Unset, Point3d.Unset, LoftType.Normal, false);
    Curve[] side1 = new Curve[2]{Innertmp[0],BaseUP[0]};
    //3
    Brep[] InnerSIDESrfUP = Brep.CreateFromLoft(side1, Point3d.Unset, Point3d.Unset, LoftType.Normal, false);
    Curve[] side2 = new Curve[2]{Innertmp[1],BaseUP[1]};
    //4
    Brep[] InnerSIDESrfUP2 = Brep.CreateFromLoft(side2, Point3d.Unset, Point3d.Unset, LoftType.Normal, false);

    Brep[] InnerBrep = new Brep[4]{InnerBaseSrf[0],InnerBaseSrfUP[0],InnerSIDESrfUP[0],InnerSIDESrfUP2[0]};
    Brep[] Blocktmp = Brep.JoinBreps(InnerBrep, Tolerance);

    Block = Blocktmp[0];

    return Block;
  }
  //Functions: Construct Breps: Pipe
  public static Brep MakingNormalPipe(Curve T1Crv1, Curve T1Crv2, Curve T2Crv1, Curve T2Crv2, double LineWidth, double Tolerance, double AngleTolerance)
  {
    //midstart
    double Middle1 = T1Crv1.GetLength();
    double Middle2 = T1Crv2.GetLength();

    Point3d T1M1 = T1Crv1.PointAtLength(Middle1 / 2.0);
    Point3d T1M2 = T1Crv2.PointAtLength(Middle2 / 2.0);

    Line connectMid = new Line(T1M1, T1M2);
    double Team1CrvLength = connectMid.ToNurbsCurve().GetLength();
    Point3d midStart = connectMid.PointAtLength(Team1CrvLength / 2.0);

    //midend
    Middle1 = T2Crv1.GetLength();
    Middle2 = T2Crv2.GetLength();

    Point3d T2M1 = T2Crv1.PointAtLength(Middle1 / 2.0);
    Point3d T2M2 = T2Crv2.PointAtLength(Middle2 / 2.0);

    connectMid = new Line(T2M1, T2M2);
    double Team2CrvLength = connectMid.ToNurbsCurve().GetLength();
    Point3d midEnd = connectMid.PointAtLength(Team2CrvLength / 2.0);

    Line Pipe = new Line(midStart, midEnd);
    double Shorten = (LineWidth / 2.0 + 0.05);
    bool Extension = Pipe.Extend(Shorten * -1, Shorten * -1);

    Brep[] Blocktmp = Brep.CreatePipe(Pipe.ToNurbsCurve(), LineWidth / 2, false, PipeCapMode.Round, true, Tolerance, AngleTolerance);
    Brep Block = Blocktmp[0];

    return Block;
  }
# ---------- end ring3d_geometry ----------
_2d_preview_only = CSharpScript(
    CountV=code_encoder.C,
    units=code_encoder.U,
    Diameter=ring_s_inner_diameter_in_mm,
    LineWidth=ring_s_wire_width,
    final=code_encoder.F,
    TotalHeight=ring_s_overall_height,
    Ratio=ratio_short_long_1_x,
    Style=list)  # -> out, A, B, C; inputs CountV: list of String, units: Double, Diameter: Double, LineWidth: Double, final: Int32, TotalHeight: Double, Ratio: Double, Style: Int32
# ---------- _2d_preview_only: C# ----------
    int TotalLayers = CountV.Count;
    Print("{0}", TotalLayers);

    //To decide short unit standard
    //First adding four moscode into a list
    double TotalLength = Diameter * Math.PI;

    //Display Preivew
    //Decide what's the height(Pt2's Y)???
    double y = 0;
    if(Style == 0) y = (TotalHeight - LineWidth) / TotalLayers;
    else if(Style == 1) y = TotalHeight / TotalLayers;

    Point3d RecPt1;
    Point3d RecPt2;

    //The most crucial part: decide the relationship between units!
    List <Brep> REC = new List<Brep>();
    List <Rectangle3d> UnitBoundary = new List<Rectangle3d>();
    for(int i = 0 ; i < TotalLayers;i++)
    {
      int index = Math.Abs(i - (TotalLayers-1));

      RecPt1 = new Point3d(0, y * index, 0);
      RecPt2 = new Point3d(0, y * (index + 1), 0);

      foreach(char v in CountV[i])
      {
        if(v == 'S')
        {
          RecPt2.X += units;
        }
        else if(v == 'L')
        {
          RecPt2.X += units * Ratio;
        }
        else if(v == 'I')
        {
          RecPt1.X -= LineWidth / 2;
          RecPt2.X += LineWidth / 2;
        }
        else if(v == 'E')
        {
          RecPt2.X += units;
          Rectangle3d RecSpace = new Rectangle3d(Plane.WorldXY, RecPt1, RecPt2);
          //UnitBoundary.Add(RecSpace);
          RecPt1.X = RecPt2.X;
          continue;
        }

        Rectangle3d Rec = new Rectangle3d(Plane.WorldXY, RecPt1, RecPt2);
        Brep[] RecB = Brep.CreatePlanarBreps(Rec.ToNurbsCurve(), doc.ModelAbsoluteTolerance);
        REC.Add(RecB[0]);
        UnitBoundary.Add(Rec);
        RecPt1.X = RecPt2.X;

        //reverse back to unit position
        if(v == 'I')
        {
          RecPt1.X += LineWidth / 2;
          RecPt2.X -= LineWidth / 2;
        }
      }
    }


    //draw grid units
    List <Line> Boundary = new List<Line>();
    for(int i = 0 ; i <= (int) final;i++)
    {
      Line Vertical = new Line(new Point3d(units * i, -LineWidth / 2, 0), new Point3d(units * i, TotalHeight + LineWidth / 2, 0));
      Boundary.Add(Vertical);
    }

    //Calculate ring wire
    for(int i = 0 ; i <= CountV.Count;i++)
    {
      Point3d RingWireS = new Point3d(0, y * i - LineWidth / 2, 0);
      Point3d RingWireE = new Point3d(TotalLength, y * i + LineWidth / 2, 0);

      if(Style == 1)
      {
        if(i == 0)
        {
          RingWireS = new Point3d(0, 0, 0);
          RingWireE = new Point3d(TotalLength, LineWidth, 0);
        }
        else if(i == CountV.Count)
        {
          RingWireS = new Point3d(0, TotalHeight - LineWidth, 0);
          RingWireE = new Point3d(TotalLength, TotalHeight, 0);
        }
      }

      Print(RingWireS.ToString());
      Rectangle3d RingWire = new Rectangle3d(Plane.WorldXY, RingWireS, RingWireE);
      Brep[] RecW = Brep.CreatePlanarBreps(RingWire.ToNurbsCurve(), doc.ModelAbsoluteTolerance);
      REC.Add(RecW[0]);

      //for horizontal line
      Line Horizontal = new Line(new Point3d(0, y * i, 0), new Point3d(TotalLength, y * i, 0));
      Boundary.Add(Horizontal);

    }

    Brep[] Join = Brep.CreateBooleanUnion(REC, doc.ModelAbsoluteTolerance);
    Join[0].MergeCoplanarFaces(doc.ModelAbsoluteTolerance);



    A = Join;
    B = Boundary;
    C = UnitBoundary;
# ---------- end _2d_preview_only ----------

# ---- group: Output View
ring_preview = Surface(_2d_preview_only.A)
grid_ref = Curve(_2d_preview_only.B)
unit_ref = Curve(_2d_preview_only.C)

# ----
c_script = CSharpScript(All=ring3d_geometry.AllBrep, Bake=are_you_ready_to_bake_your_ring, L=panel_5, C=swatch)  # -> out, A; inputs All: list of Brep, Bake: Boolean, L: String, C: Color
# ---------- c_script: C# usings ----------
using System.Drawing;
# ---------- c_script: C# ----------
    if(Bake)
    {
      Brep[] RUnion = Brep.CreateBooleanUnion(All, doc.ModelAbsoluteTolerance);
      if(RUnion == null || RUnion[0].IsSolid != true)
      {
        Print("Issue!");
        return;
      }
      Brep Ring = RUnion[0];

      Rhino.RhinoDoc Doc = Rhino.RhinoDoc.ActiveDoc;

      //add layer
      System.Drawing.Color col = new System.Drawing.Color();
      //col = System.Drawing.Color.FromArgb(255, 0, 0, 255);
      col = C;

      var layer = Doc.Layers.FindName(L, RhinoMath.UnsetIntIndex);
      if (layer == null)
      {
        Doc.Layers.Add(L, col);
      }

      //Please feel free to customise your layer name information (in this case is pretty much by typing)
      int layerIndex = Doc.Layers.FindName(L, RhinoMath.UnsetIntIndex).Index;
      //set attributes
      Rhino.DocObjects.ObjectAttributes att = new Rhino.DocObjects.ObjectAttributes();
      att.Name = "AjourCutter";
      att.LayerIndex = layerIndex;
      //bake with attributes
      RhinoDocument.Objects.AddBrep(Ring, att);

    }
# ---------- end c_script ----------
preview = CustomPreview(Geometry=ring3d_geometry.AllBrep, Material=swatch)
panel_6 = Panel(c_script.out)

# ---- group: display panels
bbox = BoundingBox(Content=flatten(ring3d_geometry.AllBrep), Plane=PlaneXY(0, 0, 0), UnionBox=True)  # -> Box, Box_2
debrep = DeconstructBrep(Brep=bbox.Box)  # -> Faces, Edges, Vertices
panel_7 = Panel("""0
3
8""")
item = ListItem(List=debrep.Edges, Index=panel_7, Wrap=True)
offset = OffsetCurve(Curve=item, Distance=1, Corners=1)  # -> flatten(Curve)
linedim = LineDimension(Line=offset, Text="{0:0.00}", Size=1)

# ----
drawingpoint = Point(Point(-0.1009410643, -3.204517318, 0))

# ---- group: display panels
panel_8 = Panel(" mm || ")
concat = Concatenate(FragmentA="Basic Unit ", FragmentB=ring3d_geometry.Unit, FragmentC=panel_8)

c_script_2 = CSharpScript(x=list)  # -> out, A; inputs x: Int32
# ---------- c_script_2: C# ----------
    if(x == 1) A = "Pipe Wire ||";
    else A = "Rectangle Wire ||";
# ---------- end c_script_2 ----------
len = Length(Curve=item)
Y = UnitY(Factor=1)  # -> expr("-x", UnitVector)
item_2 = ListItem(List=len, Index=0, Wrap=True)  # -> Item, Item1, Item2
concat_2 = Concatenate(
    FragmentA="Total Dimension : Diamter ",
    FragmentB=item_2.Item,
    FragmentC=panel_8,
    FragmentD=" Height ",
    FragmentE=item_2.Item2,
    FragmentF=panel_8)
concat_3 = Concatenate(FragmentA="Style: ", FragmentB=c_script_2.A)
concat_4 = Concatenate(FragmentA="Ratio || Short : Long units 1 : ", FragmentB=ratio_short_long_1_x)
entwine = Entwine(Branch00=concat_2, Branch01=concat_3, Branch02=concat, Branch03=concat_4, FlattenInputs=True)
flatten = FlattenTree(Tree=entwine, Path="{0}")
lng = ListLength(List=flatten)
multiplication = Multiplication(A=Slider(2, range=0..10), B=lng)

starting_pt = Point(drawingpoint)
line = LineSDL(Start=starting_pt, Direction=Y, Length=multiplication)
hframes = HorizontalFrames(Curve=line, Count=lng)  # -> Frames, Parameters

cull_i = CullIndex(List=hframes.Frames, Indices="-1", Wrap=True)

prot = RotatePlane(Plane=cull_i, Angle=degrees("90"))  # -> graft(Plane)

tag = TextTag3D(Location=prot, Text=entwine, Size=1, Justification=7)
